# Grasshopper definition Viewshed.gh (Grasshopper 0.9.76)
# plug-ins: Python Interpreter

honeybee = Honeybee_Honeybee()  # -> Vviiiiiiiiiizzz; plug-in component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
ladybug = Ladybug_Ladybug()  # -> Vviiiiiiiiiizzz; plug-in component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

# ----
# REF
srfviewfactors = Ladybug_SurfaceViewAnalysis()  # -> readMe, srfViewFactors, viewVecSrfIndex, viewVectors, viewPatches, viewPatchBasePt; plug-in component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
indoorviewfactor = Honeybee_IndoorViewFactorCalculator()  # -> readMe, port, viewFactorMesh, viewFactorInfo, port_2, testPts, viewMeshFaces, zoneWireFrame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; plug-in component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

# ----
# MATERIALS
window_u_value_w_m2_k = Slider(2, range=1..3)
window_interior_emissivity = Slider(0.9, range=0..1)
wall_r_value_m2_k_w = Panel("3")

# ----
# *Make Sure Window Geometry Faces the
# Correct Direction (Towards the Outdoors)
window_geometry = Geometry([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])
opaque_envelope_geometry = Geometry([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])
interior_context = Geometry(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)

# ----
# BASIC
# INPUTS
# GEOMETRY
comfort_eval_srf = Geometry(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)
comfort_grid_size_rhino_units = Panel("0.3")

# ----
# DEFINE ZONES
# Set Surfaces On Which
# To Observe Temperatures
brep = Brep(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)
mass2zone = Honeybee_Masses2Zones(zoneMasses=flatten(brep), isConditioned=True, maxRoofAngle=30, createHBZones=Toggle(True))  # -> readMe, HBZones; plug-in component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
panel = Panel("""0.4
0
0.4
0""")
glazingcreator = Honeybee_GlazingBasedOnRatio(HBObjects=mass2zone.HBZones, glzRatio=panel, breakUpWindow=Toggle(False), runIt=Toggle(True))  # -> readMe, HBObjWGLZ; plug-in component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

# ----
# RUN IT!
run_the_calculation = BooleanToggle(True)
list = ValueList({"Combined PPD": 0, "Radiant PPD": 1, "Downdraft PPD": 2}, selected="Combined PPD")

brep_2 = Brep([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])
geo = Geometry([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])
mass2zone_2 = Honeybee_Masses2Zones(zoneMasses=flatten(geo), maxRoofAngle=30, createHBZones=Toggle(True))  # -> readMe, HBZones; plug-in component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
python = PythonScript(fname="Honeybee_GeometricViewFactor.py")  # -> fout
# ---------- python: Python ----------
import os

if ghdoc.Path:
    fdir = os.path.dirname(ghdoc.Path)
    fout = os.path.join(fdir,fname)
# ---------- end python ----------

panel_2 = Panel("https://www.energyplus.net/weather-download/europe_wmo_region_6/FRA//FRA_Paris.Orly.071490_IWEC/all")
toggle = BooleanToggle(True)
epoutput = Honeybee_GenerateEPOutput(zoneGainsAndLosses="False", zoneComfortMetrics=toggle, comfortMapVariables=toggle, surfaceTempAnalysis=toggle)  # -> report, flatten(simulationOutputs); plug-in component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
epw_stat = Ladybug_OpenEPWAndSTATWeatherFiles(weatherFileURL=panel_2)  # -> epwFile, statFile; plug-in component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

solveadjc = Honeybee_SolveAdjacencies(HBZones=flatten(mass2zone_2.HBZones), altConstruction="Air Wall", removeCurrentAdjc=False, findAdjc=Toggle(True))  # -> readMe, HBZonesWADJ; plug-in component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

ankle_draft_acceptable_dissatisfied_ppd = Slider(20, range=10..30)
# ADVANCED
# INPUTS
# COMFORT
full_body_acceptable_dissatisfied_ppd = Slider(10, range=5..20)

# ---- group: Environmental Variables
indoor_air_temperature_c = Slider(23, range=18..24)
indoor_wind_speed_m_s = Slider(2, range=0..10, expression="x*0.05")
relative_humidity = Slider(20, range=0..100)

# ----
# SPEED / ACCURACY
viewfactor_resolution = Slider(0, range=0..3)
run_in_parallel = BooleanToggle(True)

# ---- group: Personal Variables
metabolic_rate_met = Slider(1.2, range=1..1.5)
clothing_level_clo = Slider(17, range=0..25, expression="x*0.05")

# ----
brep_3 = Brep([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])
pt = Point([Point(-40.23234766, -0.006213034444, 2.082211768), Point(-29.07180137, -0.6039756064, 2.082211768), Point(-31.05808291, 2.836364947, 2.082211768)])
file = ReadFile(File=python, PerLineParse=False)
python_2 = PythonScript(fname="Honeybee_Indoor View Factor Calculator.py")  # -> fout; same code as python
wires = BrepWireframe(Brep=brep_3, Density=-1)
wires_2 = BrepWireframe(Brep=mass2zone_2.HBZones, Density=-1)
debrep = DeconstructBrep(Brep=mass2zone_2.HBZones)  # -> flatten(Faces), Edges, Vertices
mesh = Mesh(pt=pt, surfaces=brep_3, precision="0.15")  # -> vfs_3, meshes_2, circles_2, col_2
panel_3 = Panel(debrep.Faces)
preview = CustomPreview(Geometry=wires, Shader=ColourSwatch(SwatchColor=RGB(0, 0, 0)))
boolean = Boolean(pt=pt, surfaces=brep_3)  # -> vfs_2, srf_2, col_2
toggle_2 = BooleanToggle(True)
file_2 = ReadFile(File=python_2, PerLineParse=False)
# CALCULATION
mrt_ppd_threshold = Data(full_body_acceptable_dissatisfied_ppd)
ma = MassAddition(Input=boolean.vfs_2)  # -> Result, PartialResults
dwnd_ppd_threshold = Data(ankle_draft_acceptable_dissatisfied_ppd)
preview_2 = CustomPreview(Geometry=boolean.srf_2, Shader=boolean.col_2)
indoorviewfactor_2 = Honeybee_IndoorViewFactorCalculator(Code=file_2, _HBZones=flatten(solveadjc.HBZonesWADJ), RemoveAirWalls_=Toggle(True), _buildMesh=toggle_2, _runIt=toggle_2)  # -> ReadMe, port, ViewFactorMesh, ViewFactorInfo, port_2, ViewFactorNum, TestPts, ViewMeshFaces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
window_u_value = Number(window_u_value_w_m2_k)
window_emissivity = Number(window_interior_emissivity)
comfort_eval_srf_2 = Geometry(comfort_eval_srf)
grid_size = Number(comfort_grid_size_rhino_units)
window_geometry_2 = Geometry(window_geometry)
opaque_envelope_geometry_2 = Geometry(opaque_envelope_geometry)
interior_context_2 = Geometry(interior_context)
wall_r_value = Number(wall_r_value_m2_k_w)
error = Error(act=boolean.vfs_2)  # -> error_range_2, rms_error_2
air_temperature = Number(indoor_air_temperature_c)
wind_speed = Number(indoor_wind_speed_m_s)
met_rate = Number(metabolic_rate_met)
clo_level = Number(clothing_level_clo)
relative_humidity_2 = Number(relative_humidity)
path_mapper = PathMapper(mesh.vfs_3, source="{A;B}", target="{A}")
mesh_2 = Mesh(mesh.meshes_2)
preview_3 = CustomPreview(Geometry=mesh.circles_2, Shader=ColourSwatch(SwatchColor=RGB(0, 0, 0)))
splitmass = Honeybee_SplitBuildingMass()  # -> readMe, splitBldgMasses; plug-in component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
indoorviewfactor_3 = Honeybee_IndoorViewFactorCalculator(Code=file, _srf_lst=brep_3, _pt_lst=pt, _grid_size=Slider(1, range=0..1), _runIt=Toggle(True))  # -> ReadMe, ViewVectors, Debug
python_3 = PythonScript(srf=comfort_eval_srf_2)  # -> flatten(srfCorrectDir); inputs srf: Brep
# ---------- python_3: Python ----------
import Rhino as rc

def getSrfCenPtandNormal(surface):
    brepFace = surface.Faces[0]
    if brepFace.IsPlanar and brepFace.IsSurface:
        u_domain = brepFace.Domain(0)
        v_domain = brepFace.Domain(1)
        centerU = (u_domain.Min + u_domain.Max)/2
        centerV = (v_domain.Min + v_domain.Max)/2
        
        centerPt = brepFace.PointAt(centerU, centerV)
        normalVector = brepFace.NormalAt(centerU, centerV)
    else:
        centroid = rc.Geometry.AreaMassProperties.Compute(brepFace).Centroid
        uv = brepFace.ClosestPoint(centroid)
        centerPt = brepFace.PointAt(uv[1], uv[2])
        normalVector = brepFace.NormalAt(uv[1], uv[2])
    
    return normalVector

if srf and getSrfCenPtandNormal(srf).Z < 0:
    rc.Geometry.Brep.Flip(srf)

srfCorrectDir = srf
# ---------- end python_3 ----------
panel_4 = Panel(ma.Result)
panel_5 = Panel([error.error_range_2, error.rms_error_2])
# 2
toggle_3 = BooleanToggle(True)

# ----
# TEST PTS
# CLIMATE
seated_person_avg_height_meters = Panel("0.85")
python_4 = PythonScript(valInMeters=seated_person_avg_height_meters)  # -> valInRhinoUnits; inputs valInMeters: list
# ---------- python_4: Python ----------
import scriptcontext as sc

units = sc.doc.ModelUnitSystem
if `units` == 'Rhino.UnitSystem.Meters': conversionFactor = 1.00
elif `units` == 'Rhino.UnitSystem.Centimeters': conversionFactor = 0.01
elif `units` == 'Rhino.UnitSystem.Millimeters': conversionFactor = 0.001
elif `units` == 'Rhino.UnitSystem.Feet': conversionFactor = 0.305
elif `units` == 'Rhino.UnitSystem.Inches': conversionFactor = 0.0254
else:
    warning = 'Kidding me! Which units are you using?'+ `units`+'?' + \
        'Please use Meters, Centimeters, Millimeters, Inches or Feet'
    conversionFactor = 1.00

valInRhinoUnits = []
for val in valInMeters:
    valInRhinoUnits.append(val/conversionFactor)
# ---------- end python_4 ----------
genmesh = Ladybug_GenerateMesh(testGeometry=python_3, gridSize=grid_size, distBaseSrf=python_4, moveTestMesh=Toggle(False))  # -> readMe, simplify(testPoints), simplify(ptsVectors), simplify(facesArea), simplify(mesh); plug-in component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
neg = Negative(Value=python_4)
pt_2 = ConstructPoint(XCoordinate=0, YCoordinate=0, ZCoordinate=neg)
move = Move(Geometry=genmesh.testPoints, Motion=pt_2)  # -> Geometry, Transform
mjoin = MeshJoin(Meshes=flatten(genmesh.mesh))

# ----
# CALCULATE
# VIEW FACTORS
# 1
toggle_4 = BooleanToggle(True)
ma_2 = MassAddition(Input=path_mapper)  # -> Result, PartialResults
python_5 = PythonScript(vf=indoorviewfactor_2.ViewFactorNum)  # -> a; inputs vf: list
# ---------- python_5: Python ----------
import pprint

#pprint.pprint(vf)

vpt_num = len(vf[0]) 

vf_by_srf = len(vf[0][1]) #for each srf, viewfactor
# ---------- end python_5 ----------
division = Division(A="1", B=wall_r_value)
panel_6 = Panel(indoorviewfactor_2.ViewVectors)
faceb = FaceBoundaries(Mesh=indoorviewfactor_2.ViewFactorMesh)
vdisex = VectorDisplayEx(Point=indoorviewfactor_2.TestPts, Vector=indoorviewfactor_2.ViewVectors, Colour=RGB(0, 0, 0), Width=2)

indoorviewfactor_4 = Honeybee_IndoorViewFactorCalculator(
    HBZones=flatten(glazingcreator.HBObjWGLZ),
    gridSize="0.5",
    distFromFloorOrSrf=flatten(brep_2),
    includeOutdoor=Toggle(True),
    parallel=Toggle(True),
    buildMesh=toggle_3,
    runIt=toggle_3)  # -> readMe, port, viewFactorMesh, viewFactorInfo, port_2, testPts, viewMeshFaces, zoneWireFrame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; plug-in component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

panel_7 = Panel(ma_2.Result)
panel_8 = Panel(indoorviewfactor_3.ViewVectors)
panel_9 = Panel(indoorviewfactor_3.Debug)

exporttoopenstudio = Honeybee_ExportToOpenStudio(
    epwWeatherFile=epw_stat.epwFile,
    HBZones=flatten(glazingcreator.HBObjWGLZ),
    simulationOutputs=flatten(epoutput.simulationOutputs),
    writeOSM=toggle_4,
    runSimulation=toggle_4)  # -> readMe, osmFileAddress, idfFileAddress, resultFileAddress, eioFileAddress, rddFileAddress, htmlReport, studyFolder, model; plug-in component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
readepsrfresult = Honeybee_ReadEPSurfaceResult(resultFileAddress=exporttoopenstudio.resultFileAddress)  # -> surfaceIndoorTemp, surfaceOutdoorTemp, port, port_2, port_3, port_4, port_5, port_6, windowTransmissivity, port_7; plug-in component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
readepresult = Honeybee_ReadEPResult(resultFileAddress=exporttoopenstudio.resultFileAddress)  # -> port, port_2, port_3, port_4, port_5, port_6, port_7, port_8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; plug-in component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

int = Integer(viewfactor_resolution)
bool = Boolean(run_in_parallel)
bool_2 = Boolean(run_the_calculation)
preview_4 = CustomPreview(Geometry=indoorviewfactor_4.zoneWireFrame, Shader=ColourSwatch(SwatchColor=RGB(0, 0, 0)))
# VISUALIZE MICROCLIMATE MAP
# 3
toggle_5 = BooleanToggle(True)

importstat = Ladybug_ImportStat(statFile=epw_stat.statFile)  # -> readMe, ashraeClimateZone, koppenClimateZone, port, heatingDesignTemp, coolingDesignTemp, port_2, extremeHotWeek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; plug-in component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
adaptcomfrecipe = Honeybee_AdaptiveComfortAnalysisRecipe(
    viewFactorMesh=indoorviewfactor_4.viewFactorMesh,
    viewFactorInfo=indoorviewfactor_4.viewFactorInfo,
    epwFile=epw_stat.epwFile,
    srfIndoorTemp=readepsrfresult.surfaceIndoorTemp,
    srfOutdoorTemp=readepsrfresult.surfaceOutdoorTemp,
    zoneAirTemp=readepresult.airTemperature,
    zoneAirFlowVol=readepresult.airFlowVolume,
    zoneAirHeatGain=readepresult.airHeatGainRate)  # -> comfRecipe; plug-in component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
microclimatemap = Honeybee_MicroclimateMapAnalysis(
    comfAnalysisRecipe=adaptcomfrecipe,
    analysisPeriodOrHOY=importstat.extremeHotWeek,
    writeResultFile=Toggle(False),
    parallel=toggle_5,
    runIt=toggle_5)  # -> readMe, port, radTempMtx, airTempMtx, operativeTempMtx, adaptComfMtx, degFromTargetMtx, port_2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; plug-in component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

# ----
# Scroll Through the Hours of the Simulation
number_slider = Slider(18, range=1..24)
legendpar = Ladybug_LegendParameters(lowBound="18", highBound="38")  # -> legendPar; plug-in component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
visualizemicroclimate = Honeybee_VisualizeMicroclimateMap(
    comfResultsMtx=microclimatemap.operativeTempMtx,
    viewFactorMesh=flatten(indoorviewfactor_4.viewFactorMesh),
    stepOfSimulation=number_slider,
    legendPar=legendpar)  # -> readMe, port, resultMesh, legend, legendBasePt, port_2, resultValues, resultColors; plug-in component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

window_geometry_3 = Geometry(window_geometry_2)
interior_geometry = Geometry(interior_context_2)
wall_geometry = Geometry(opaque_envelope_geometry_2)
test_mesh = Mesh(mjoin)

# ----
# Visualize Geometry
interior_geometry_2 = Geometry(interior_geometry)
wall_geometry_2 = Geometry(wall_geometry)
window_geometry_4 = Geometry(window_geometry_3)
edges = BrepEdges(Brep=[window_geometry_4, wall_geometry_2])  # -> Naked, Interior, NonManifold
preview_5 = CustomPreview(Geometry=[edges.Naked, edges.Interior], Shader=ColourSwatch(SwatchColor=RGB(0, 0, 0)))
preview_6 = CustomPreview(Geometry=window_geometry_4, Shader=ColourSwatch(SwatchColor=RGBA(74, 192, 255, 173)))
preview_7 = CustomPreview(Geometry=wall_geometry_2, Shader=ColourSwatch(SwatchColor=RGB(171, 171, 171)))

test_mesh_2 = Mesh(test_mesh)

# ----
# CLIMATE
weather_file_url = Panel("https://www.energyplus.net/weather-download/north_and_central_america_wmo_region_4/USA/MA/USA_MA_Boston-Logan.Intl.AP.725090_TMY3/all")
time_discomfort = Slider(0.4, range=0..5)
occupancy_start_hour = Panel("8")
occupancy_end_hour = Panel("18")

epw_file = Data(weather_file_url)
uncomfortable_time = Number(time_discomfort)
starthour = Integer(occupancy_start_hour)
endhour = Integer(occupancy_end_hour)

epw_stat_2 = Ladybug_OpenEPWAndSTATWeatherFiles(weatherFileURL=epw_file)  # -> epwFile, statFile; plug-in component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
importepw = Ladybug_ImportEpw(epwFile=epw_stat_2.epwFile)  # -> readMe, latitude, location, dryBulbTemperature, dewPointTemperature, relativeHumidity, windSpeed, windDirection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; plug-in component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
analysisperiod = Ladybug_AnalysisPeriod(fromHour=starthour, toHour=endhour)  # -> readMe, analysisPeriod; plug-in component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
selectandaveragedata = Ladybug_AverageData(annualHourlyData=importepw.dryBulbTemperature, analysisPeriod=analysisperiod.analysisPeriod)  # -> readMe, selHourlyData, averagedDaily, averagedMonthly, avrMonthlyPerHour, avrAnalysisPeriod; plug-in component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
strnum = Ladybug_SeparateData(inputList=flatten(selectandaveragedata.selHourlyData))  # -> numbers, strings; plug-in component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
division_2 = Division(A=uncomfortable_time, B="100")
lng = ListLength(List=strnum.numbers)
multiplication = Multiplication(A=lng, B=division_2)
round = Round(Number=multiplication)  # -> Nearest, Floor, Ceiling
sort = SortList(Keys=strnum.numbers)  # -> Keys, ValuesA
item = ListItem(List=sort.Keys, Index=round.Nearest, Wrap=True)

outdoor_temperature_c = Panel(item)

# ----
# Opaque Facade
srfviewfactors_2 = Ladybug_SurfaceViewAnalysis(
    testPtsOrPlanes=flatten(genmesh.testPoints),
    testSrfs=opaque_envelope_geometry_2,
    context=interior_context_2,
    viewResolution=int,
    parallel=bool,
    runIt=bool_2)  # -> readMe, srfViewFactors, viewVecSrfIndex, viewVectors, viewPatches, viewPatchBasePt; plug-in component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
# MRT
sssrftemp = Ladybug_SteadyStateSurfaceTemperature(outTemp=item, inTemp=air_temperature, uValue=division)  # -> inFilmCoeff, extFilmCoeff, inSrfTemp, extSrfTemp; plug-in component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
ma_3 = MassAddition(Input=srfviewfactors_2.srfViewFactors)  # -> flatten(Result), PartialResults
multiplication_2 = Multiplication(A=sssrftemp.inSrfTemp, B=ma_3.Result)

panel_10 = Panel(sssrftemp.inSrfTemp)
panel_11 = Panel(srfviewfactors_2.srfViewFactors)

# ----
# Glazed Facade
srfviewfactors_3 = Ladybug_SurfaceViewAnalysis(
    testPtsOrPlanes=flatten(genmesh.testPoints),
    testSrfs=window_geometry_2,
    context=interior_context_2,
    viewResolution=int,
    parallel=bool,
    runIt=bool_2)  # -> readMe, srfViewFactors, viewVecSrfIndex, viewVectors, viewPatches, viewPatchBasePt; plug-in component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
sssrftemp_2 = Ladybug_SteadyStateSurfaceTemperature(outTemp=item, inTemp=air_temperature, uValue=window_u_value, intEmiss=window_emissivity)  # -> inFilmCoeff, extFilmCoeff, inSrfTemp, extSrfTemp; plug-in component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
ma_4 = MassAddition(Input=srfviewfactors_3.srfViewFactors)  # -> flatten(Result), PartialResults
window_surface_temperature = Number(sssrftemp_2.inSrfTemp)

# ---- group: Glass Emissivity
clo_emis = Panel("0.9")
subtraction = Subtraction(A=air_temperature, B=sssrftemp_2.inSrfTemp)
subtraction_2 = Subtraction(A=clo_emis, B=window_emissivity)
division_3 = Division(A=subtraction_2, B=clo_emis)
multiplication_3 = Multiplication(A=subtraction, B=division_3)
addition = Addition(A=sssrftemp_2.inSrfTemp, B=multiplication_3)

# ----
addition_2 = Addition(A=ma_4.Result, B=ma_3.Result)
subtraction_3 = Subtraction(A="1", B=addition_2)
multiplication_4 = Multiplication(A=air_temperature, B=subtraction_3)

multiplication_5 = Multiplication(A=addition, B=ma_4.Result)

addition_3 = Addition(A=multiplication_2, B=multiplication_4, C=multiplication_5)

# ----
# PMV
pmvcomfortcalculator = Ladybug_PMVComfortCalculator(
    dryBulbTemperature=air_temperature,
    meanRadiantTemperature=addition_3,
    windSpeed=wind_speed,
    relativeHumidity=relative_humidity_2,
    metabolicRate=met_rate,
    clothingLevel=clo_level,
    calcBalanceTemperature=False,
    runIt=bool_2)  # -> readMe, port, predictedMeanVote, percentPeopleDissatisfied, standardEffectiveTemperature, port_2, comfortableOrNot, percentOfTimeComfortable, port_3, balanceTemperature; plug-in component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
ppd_threshold = Data(mrt_ppd_threshold)
ppd_radiant = Data(pmvcomfortcalculator.percentPeopleDissatisfied)
subtraction_4 = Subtraction(A=ppd_radiant, B=ppd_threshold)

window_surface_temperature_2 = Number(window_surface_temperature)
# DOWNDRAFT
air_temperature_2 = Number(air_temperature)
downdraft = Ladybug_WindowDowndraft(
    testPts=move.Geometry,
    windowSrfs=window_geometry_2,
    winSrfTemp=window_surface_temperature_2,
    airTemp=air_temperature_2,
    defaultVeloc=wind_speed,
    runIt=bool_2)  # -> draftAirTemp, draftAirVeloc, port, airFlowPlanes; plug-in component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
ankledraftcomf = Ladybug_AnkleDraftDiscomfort(fullBodyPMV=pmvcomfortcalculator.predictedMeanVote, draftAirVeloc=downdraft.draftAirVeloc)  # -> PPD; plug-in component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
ppd_downdraft = Data(ankledraftcomf)
ppd_threshold_2 = Data(dwnd_ppd_threshold)
subtraction_5 = Subtraction(A=ppd_downdraft, B=ppd_threshold_2)

max = Maximum(A=subtraction_4, B=subtraction_5)

# ----
# Select Correct Visual Parameters
panel_12 = Panel("""COMBINED DISCOMFORT
RADIANT DISCOMFORT
DONWDRAFT DISCOMFORT""")
visualizationtype = Data(list)
ppd_thresholds = Data(["0", ppd_threshold, ppd_threshold_2])
subtraction_6 = Subtraction(A=ppd_thresholds, B="10")
addition_4 = Addition(A=ppd_thresholds, B="10")
item_2 = ListItem(List=ppd_thresholds, Index=visualizationtype, Wrap=True)
item_3 = ListItem(List=subtraction_6, Index=visualizationtype, Wrap=True)
item_4 = ListItem(List=addition_4, Index=visualizationtype, Wrap=True)
item_5 = ListItem(List=panel_12, Index=visualizationtype, Wrap=True)

# ----
# DISPLAY
# Select Correct Dataset
ppd_combined = Data(flatten(max))
ppd_downdraft_2 = Data(flatten(ankledraftcomf))
ppd_radiant_2 = Data(flatten(pmvcomfortcalculator.percentPeopleDissatisfied))
replace = ReplacePaths(Data=ppd_downdraft_2, Search="{0}", Replace="{2}")
replace_2 = ReplacePaths(Data=ppd_radiant_2, Search="{0}", Replace="{1}")
ppd_combined_2 = Data([ppd_combined, replace_2, replace])
branch = TreeBranch(Tree=ppd_combined_2, Path=visualizationtype, MaintainPaths=True)
ppd_display = Data(branch)

# ----
# Color Scheme
panel_13 = Panel("12")
gradientlibrary = Ladybug_GradientLibrary(gradIndex=panel_13)  # -> customColors; plug-in component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
rev = ReverseList(List=gradientlibrary)
legendpar_2 = Ladybug_LegendParameters(lowBound=item_3, highBound=item_4, customColors=flatten(rev), decimalPlaces="0", removeLessThan=Toggle(True))  # -> legendPar; plug-in component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

# ----
# Colored Mesh
panel_14 = Panel("1")
python_6 = PythonScript(valInMeters=panel_14)  # -> valInRhinoUnits; inputs valInMeters: list; same code as python_4
recolormesh = Ladybug_RecolorMesh(
    analysisResult=ppd_display,
    inputMesh=test_mesh_2,
    heightDomain=python_6,
    legendPar=legendpar_2,
    analysisTitle=item_5,
    legendTitle="PPD")  # -> readMe, newMesh, newLegend, legendBasePt, meshColors, legendColors; plug-in component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
item_6 = ListItem(List=recolormesh.newLegend, Index=0, Wrap=True)
medges = MeshEdges(Mesh=item_6)  # -> NakedEdges, InteriorEdges, NonManifoldEdges

# ----
# Define Discomfort Region
meshselector = Ladybug_MeshThresholdSelector(inputMesh=recolormesh.newMesh, analysisResult=flatten(ppd_display), levelOfPerform=item_2)  # -> readMe, totalValue, areaMeetsThresh, newColoredMesh, newMeshOutline; plug-in component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
preview_8 = CustomPreview(
    Geometry=[meshselector.newMeshOutline, medges.NakedEdges, medges.InteriorEdges],
    Shader=ColourSwatch(SwatchColor=RGB(0, 0, 0)))

# ==== cluster Boolean
surfaces = ClusterInput()
pt = ClusterInput()
surfaces_2 = Brep(surfaces)
pt_2 = Point(pt)
mesh = MeshBrep(
    Brep=surfaces_2,
    Settings={GridMaxCount=0, GridMinCount=16, JaggedSeams=False, MaxEdgeLength=0, MinEdgeLength=0.0001, MinTolerance=0, Refine=True, RefineAngle=0, RelativeTolerance=0.65, SimplePlanes=True, Tolerance=0})
faceb = FaceBoundaries(Mesh=mesh)  # -> simplify(graft(Boundaries))
rhatt = GetRhinoAttributes(Geometry=surfaces_2)  # -> Name, Layer, Colour
sph = Sphere(Base=pt_2, Radius=1)
extr = ExtrudePoint(Base=faceb, Point=pt_2)
cap = CapHoles(Brep=extr)
sint = SolidIntersection(BrepsA=sph, BrepsB=cap)
debrep = DeconstructBrep(Brep=sint)  # -> simplify(graft(Faces)), Edges, Vertices
debrep_2 = DeconstructBrep(Brep=debrep.Faces)  # -> Faces, Edges, Vertices
cp = ClosestPoint(Point=pt_2, Cloud=debrep_2.Vertices)  # -> ClosestPoint, CPIndex, simplify(Distance)
cull = CullPattern(List=debrep.Faces, CullPattern=cp.Distance)
path_mapper = PathMapper(cull, source="{A;B;C}", target="{A}")
srf = Surface(path_mapper)
area = Area(Geometry=srf)  # -> Area, Centroid
ma = MassAddition(Input=area.Area)  # -> Result, PartialResults
path_mapper_2 = PathMapper(ma.Result, source=["{A;B}", "{A}"], target=["{A}", "{0}"])
col = Colour(graft(rhatt.Colour))
division = Division(A=path_mapper_2, B=12.56637061)
vfs = Number(division)
srf_2 = ClusterOutput(srf)
col_2 = ClusterOutput(col)
vfs_2 = ClusterOutput(vfs)
preview = CustomPreview(Geometry=srf, Shader=col)

# ==== cluster Mesh
pt = ClusterInput()
surfaces = ClusterInput()
precision = ClusterInput()
surfaces_2 = Brep(surfaces)
precision_2 = Number(precision)
pt_2 = Point(pt)
brep_cp = BrepClosestPoint(Point=graft(pt_2), Brep=surfaces_2)  # -> Point, Distance
multiplication = Multiplication(A=brep_cp.Distance, B=precision_2)
geo = Geometry(brep_cp.Point)
custom_mesh_settings = SettingsCustom(
    StitchSeams=True,
    SimplePlanes=False,
    Refine=True,
    MinCount=16,
    MaxCount=400,
    AspectRatio=20,
    MaxDistance=0,
    MaxAngle=20,
    MinEdge=multiplication,
    MaxEdge=multiplication)
mesh = MeshBrep(Brep=surfaces_2, Settings=simplify(custom_mesh_settings))
jagged = SettingsSpeed()
mesh_2 = Mesh(mesh)
mesh_3 = MeshBrep(Brep=surfaces_2, Settings=jagged)
explode = MeshExplode(Mesh=mesh_2, Interpolate=False)
facen = FaceNormals(Mesh=mesh_2)  # -> Centers, Normals
mjoin = MeshJoin(Meshes=mesh_3)
area = MeshArea(Mesh=explode)  # -> Area, Centroid
c_script = CSharpScript(Points=pt_2, Occlusion=mjoin, MeshFaceCenters=facen.Centers, MeshFaceNormals=facen.Normals, MeshFaceAreas=area.Area)  # -> out, A, B, C; inputs Points: list of Point3d, Occlusion: Mesh, MeshFaceCenters: tree of Point3d, MeshFaceNormals: tree of Vector3d, MeshFaceAreas: tree of Double
# ---------- c_script: C# ----------
    DataTree<Point3d> outputCenters = new DataTree<Point3d>();
    DataTree<Vector3d> outputVectors = new DataTree<Vector3d>();

    DataTree<double> factors = new DataTree<double>();
    DataTree<double> circles = new DataTree<double>();

    for (int i = 0; i < MeshFaceCenters.BranchCount; i++)
    {
      GH_Path path = MeshFaceCenters.Path(i);
      int pointId = path.Indices[0];
      int meshId = path.Indices[1];
      Point3d p = Points[pointId];
      int faceId = 0;
      MeshFaceCenters.Branch(i).ForEach(center => {
        if (visible(p, center, Occlusion)){
          Vector3d vec = new Vector3d(center.X - p.X, center.Y - p.Y, center.Z - p.Z);

          Vector3d norm = MeshFaceNormals.Branch(i)[faceId];
          vec.Unitize();
          norm.Unitize();

          double distance = p.DistanceTo(center);
          double area = MeshFaceAreas.Branch(i)[faceId];
          double cosTh = Math.Abs(vec.X * norm.X + vec.Y * norm.Y + vec.Z * norm.Z);
          double factor = cosTh * area / (distance * distance);
          Point3d outPt = Point3d.Add(p, vec);

          factors.Add(factor, path);
          outputCenters.Add(outPt, path);
          outputVectors.Add(vec, path);
        }
        faceId++;
        });
    }

   
    A = outputCenters;
    B = outputVectors;
    C = factors;
# ---------- c_script: C# additional code ----------
  public static bool visible(Point3d start, Point3d end, Mesh mesh)
  {
    Line line = new Line(start, end);
    int[] faces;
    Point3d[] intersections = Rhino.Geometry.Intersect.Intersection.MeshLine(mesh, line, out faces);
    //if (faces == null) return true;
    if (intersections.Length < 2) return true;
    else{
      bool visible = true;
      double distance = start.DistanceTo(end);
      for (int i = 0; i < intersections.Length; i++)
      {
        Point3d center = intersections[i];
        double distToStart = center.DistanceTo(start);
        double distToEnd = center.DistanceTo(end);
        if (distToStart < distance && distToEnd < distance)
        {
          // point is in between and hence face occludes
          visible = false;
          i = faces.Length;
        }
      }
      return visible;
    }
  }


  public static Point3d getMeshFaceCenter(Mesh mesh, int j)
  {
    try
    {
      return AreaMassProperties.Compute(faceOfMesh(mesh, j)).Centroid;
    }
    catch
    {
      return new Point3d();
    }
  }

  public static double getMeshFaceArea(Mesh mesh, int j)
  {
    try
    {
      return AreaMassProperties.Compute(faceOfMesh(mesh, j)).Area;
    }
    catch
    {
      return 1.0;
    }
  }

  private static void computeFaceNormals(Mesh mesh)
  {
    mesh.FaceNormals.ComputeFaceNormals();
  }

  private static Mesh faceOfMesh(Mesh mesh, int j)
  {
    Mesh newMesh = new Mesh();
    newMesh.Vertices.Add(mesh.Vertices[mesh.Faces[j].A]);
    newMesh.Vertices.Add(mesh.Vertices[mesh.Faces[j].B]);
    newMesh.Vertices.Add(mesh.Vertices[mesh.Faces[j].C]);
    if (mesh.Faces[j].IsQuad)
    {
      newMesh.Vertices.Add(mesh.Vertices[mesh.Faces[j].D]);
      newMesh.Faces.AddFace(0, 1, 2, 3);
    }
    else
    {
      newMesh.Faces.AddFace(0, 1, 2);
    }
    return newMesh;
  }
# ---------- end c_script ----------
path_mapper = PathMapper(c_script.C, source="{A;B}", target="{A}")
pi = Pi(Factor=1)
ma = MassAddition(Input=path_mapper)  # -> Result, PartialResults
division = Division(A=c_script.C, B=pi)
division_2 = Division(A=c_script.C, B=12.56637061)
sqrt = SquareRoot(Value=division)
vfs = Number(division_2)
circle = CircleCNR(Center=c_script.A, Normal=c_script.B, Radius=sqrt)
ma_2 = MassAddition(Input=vfs)  # -> Result, PartialResults
polygon = Polygon(Plane=PlaneXY(0, 0, 0), Radius=1, Segments=12, FilletRadius=0)  # -> Polygon, Length
darc = DeconstructArc(Arc=circle)  # -> BasePlane, Radius, Angle
path_mapper_2 = PathMapper(circle, source="{A;B}", target="{B}")
rhatt = GetRhinoAttributes(Geometry=surfaces_2)  # -> Name, Layer, Colour
cir = Circle(Plane=PlaneXY(0, 0, 0), Radius=1)
swatch = ColourSwatch(SwatchColor=RGB(183, 128, 255))
mesh_4 = MeshBrep(
    Brep=polygon.Polygon,
    Settings={GridMaxCount=0, GridMinCount=16, JaggedSeams=False, MaxEdgeLength=0, MinEdgeLength=0.0001, MinTolerance=0, Refine=True, RefineAngle=0, RelativeTolerance=0.65, SimplePlanes=True, Tolerance=0})
scale = Scale(Geometry=mesh_4, Center=Point(0, 0, 0), Factor=darc.Radius)  # -> Geometry, Transform
col = Colour(graft([ColourSwatch(SwatchColor=RGB(255, 255, 0)), ColourSwatch(SwatchColor=RGB(255, 0, 0)), ColourSwatch(SwatchColor=RGB(0, 255, 255)), ColourSwatch(SwatchColor=RGB(255, 0, 255)), ColourSwatch(SwatchColor=RGB(0, 0, 255)), ColourSwatch(SwatchColor=RGB(0, 255, 134)), ColourSwatch(SwatchColor=RGB(105, 185, 255)), ColourSwatch(SwatchColor=RGB(255, 115, 0)), ColourSwatch(SwatchColor=RGB(255, 0, 132)), ColourSwatch(SwatchColor=RGB(29, 133, 52)), ColourSwatch(SwatchColor=RGB(255, 0, 166)), ColourSwatch(SwatchColor=RGB(76, 0, 0)), ColourSwatch(SwatchColor=RGB(255, 0, 0))]))
orient = Orient(Geometry=scale.Geometry, Source=PlaneXY(0, 0, 0), Target=darc.BasePlane)  # -> Geometry, Transform
path_mapper_3 = PathMapper(orient.Geometry, source="{A;B}", target="{B}")
mcol = MeshColours(Mesh=path_mapper_3, Colours=col)
vfs_2 = Number(ma_2.Result)
circles = Circle(path_mapper_2)
meshes = Mesh(mcol)
preview = CustomPreview(Geometry=circles, Shader=col)
meshes_2 = ClusterOutput(meshes)
circles_2 = ClusterOutput(circles)
vfs_3 = ClusterOutput(vfs_2)
col_2 = ClusterOutput(col)

# ==== cluster Error
act = ClusterInput()
approx = ClusterInput()
act_2 = Number(act)
approx_2 = Number(approx)
subtraction = Subtraction(A=act_2, B=approx_2)
sqr = Square(Value=subtraction)
avr = Average(Input=sqr)
bnd = Bounds(Numbers=subtraction)
sqrt = SquareRoot(Value=avr)
error_range = Domain(bnd)
rms_error = Number(sqrt)
error_range_2 = ClusterOutput(error_range)
rms_error_2 = ClusterOutput(rms_error)
